# Grasshopper definition CarboCrocSampleProjectBaked.gh (Grasshopper 1.0.7)
# plug-ins: CarboCroc, ShapeDiverForGrasshopper

sddp = ShapeDiverDocumentPayload({AbsoluteTolerance=0, AngleTolerance=0, DistanceDisplayPrecision=0, GltfVersion="Gltf2", GrasshopperVersion="1.0.0007", InputGroups="{}", OutputGroups="{}", RelativeTolerance=0, RhinoVersion="7.37.24107.15001", UnitSystem=0, VersionCreated="1.16.1.0", VersionSaved="1.16.1.0"})
geo = Geometry([<brep referenced from the Rhino model> x2])
geo_2 = Geometry([<brep referenced from the Rhino model> x8])
volume = Volume(Geometry=geo)  # -> Volume, Centroid
id = Guid(geo)
volume_2 = Volume(Geometry=geo_2)  # -> Volume, Centroid
material = Materials({"Concrete - Mortar/screed": 0, "Concrete UK - C40/50 - Precast": 1, "Concrete UK - C32/40 - 25% GGBS": 2, "Concrete UK - C25/30 - 25% GGBS": 3, "Concrete UK - C20/25 - 25% GGBS": 4, "Concrete UK - C16/20 - 25% GGBS": 5, "Concrete UK - C40/50 - 25% GGBS": 6, "Concrete - C32/40 Mean": 7, "Concrete UK - C40/50 - Precast 150mm Hollowcore": 8, "Steel UK - Reinforcement": 9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}, selected="Concrete UK - C32/40 - 25% GGBS")
material_2 = Materials({"Concrete - Mortar/screed": 0, "Concrete UK - C40/50 - Precast": 1, "Concrete UK - C32/40 - 25% GGBS": 2, "Concrete UK - C25/30 - 25% GGBS": 3, "Concrete UK - C20/25 - 25% GGBS": 4, "Concrete UK - C16/20 - 25% GGBS": 5, "Concrete UK - C40/50 - 25% GGBS": 6, "Concrete - C32/40 Mean": 7, "Concrete UK - C40/50 - Precast 150mm Hollowcore": 8, "Steel UK - Reinforcement": 9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}, selected="Steel - Generic": 82)
list_all_materials = ListMaterials()
list_all_materials_2 = ListMaterials()
geo_3 = Geometry(geo)
panel = Panel("Steel")
geo_4 = Geometry(geo_2)
item = ListItem(List=list_all_materials, Index=material, Wrap=True)
item_2 = ListItem(List=list_all_materials_2, Index=material_2, Wrap=True)

# ---- group: Settings
boolean_toggle = BooleanToggle(True)  # "A1-A3"
a4 = BooleanToggle(True)
a5 = BooleanToggle(True)
boolean_toggle_2 = BooleanToggle(True)  # "B1-B6"
boolean_toggle_3 = BooleanToggle(True)  # "C1-C4"
D = BooleanToggle(False)
sequestration = BooleanToggle(True)
additional = BooleanToggle(True)
carbo_life_switches = CarboLifeSwitches(
    A1A3=boolean_toggle,
    A4=a4,
    A5=a5,
    B1B6=boolean_toggle_2,
    C1C4=boolean_toggle_3,
    D=D,
    Seq=sequestration,
    Extra=additional)  # -> Message, CarboSwitches
panel_3 = Panel(carbo_life_switches.Message)

# ----
id_2 = Guid(geo_4)

# ---- group: GEOMETRY
number_slider = Slider(9, range=0..50)
number_slider_2 = Slider(0.169, range=0.1..1)
number_slider_3 = Slider(0.292, range=0.1..1)
number_slider_4 = Slider(3, range=0..5)
pt = ConstructPoint(XCoordinate=number_slider, YCoordinate=0, ZCoordinate=0)
pt_2 = ConstructPoint(XCoordinate=number_slider, YCoordinate=number_slider, ZCoordinate=0)
pt_3 = ConstructPoint(XCoordinate=0, YCoordinate=number_slider, ZCoordinate=0)
pt_4 = ConstructPoint(XCoordinate=0, YCoordinate=0, ZCoordinate=0)
num = Number(number_slider)
multiplication = Multiplication(A=number_slider_2, B="-1")
vec = VectorXYZ(XComponent=number_slider_2, YComponent=number_slider_2, ZComponent=0)  # -> Vector, Length
vec_2 = VectorXYZ(XComponent=multiplication, YComponent=multiplication, ZComponent=0)  # -> Vector, Length
pt_5 = ConstructPoint(XCoordinate=0, YCoordinate=0, ZCoordinate=0)
pline = PolyLine(Vertices=[pt_4, pt, pt_2, pt_3], Closed=True)
vec_3 = VectorXYZ(XComponent=0, YComponent=0, ZComponent=number_slider_3)  # -> Vector, Length
vec_4 = VectorXYZ(XComponent=0, YComponent=0, ZComponent=number_slider_4)  # -> Vector, Length
move = Move(Geometry=pt_5, Motion=vec.Vector)  # -> Geometry, Transform
srf = Surface(pline)
move_2 = Move(Geometry=pt_5, Motion=vec_2.Vector)  # -> Geometry, Transform
panel_4 = Panel("1000")
rec_2pt = Rectangle2Pt(Plane=PlaneXY(0, 0, 0), PointA=move.Geometry, PointB=move_2.Geometry, Radius=0)  # -> Rectangle, Length
extr = Extrude(Base=srf, Direction=vec_3.Vector)
srf_2 = Surface(rec_2pt.Rectangle)
num_2 = Number(num)
extr_2 = Extrude(Base=srf_2, Direction=vec_4.Vector)
move_3 = Move(Geometry=extr, Motion=vec_4.Vector)  # -> Geometry, Transform
vec_5 = VectorXYZ(XComponent=num_2, YComponent=0, ZComponent=0)  # -> Vector, Length
vec_6 = VectorXYZ(XComponent=num_2, YComponent=num_2, ZComponent=0)  # -> Vector, Length
vec_7 = VectorXYZ(XComponent=0, YComponent=num_2, ZComponent=0)  # -> Vector, Length
move_4 = Move(Geometry=extr_2, Motion=[vec_5.Vector, vec_6.Vector, vec_7.Vector])  # -> Geometry, Transform
geo_5 = Geometry(move_3.Geometry)
geo_6 = Geometry([move_4.Geometry, extr_2])

# ----
multiplication_2 = Multiplication(A=number_slider_3, B=panel_4)
vec_8 = VectorXYZ(XComponent=0, YComponent=0, ZComponent=number_slider_4)  # -> Vector, Length

# ---- group: GEOMETRY (continued)
join = TextJoin(Text=[multiplication_2, " THK RC SLAB"])
panel_5 = Panel(join)

# ----
move_5 = Move(Geometry=geo_5, Motion=vec_8.Vector)  # -> Geometry, Transform
move_6 = Move(Geometry=geo_6, Motion=vec_8.Vector)  # -> Geometry, Transform

number_slider_5 = Slider(157, range=0..1000)
number_slider_6 = Slider(217, range=0..1000)
rgb = ColourRGB(Alpha=255, Red=number_slider_5, Green=number_slider_5, Blue=number_slider_5)
rgb_2 = ColourRGB(Alpha=255, Red=number_slider_6, Green=number_slider_6, Blue=number_slider_6)
material_3 = CreateMaterial(Diffuse=rgb, Specular=RGB(255, 255, 255), Emission=RGB(0, 0, 0), Transparency=0, Shine=0)
material_4 = CreateMaterial(Diffuse=rgb_2, Specular=RGB(255, 255, 255), Emission=RGB(0, 0, 0), Transparency=0, Shine=0)
preview = CustomPreview(Geometry=[move_6.Geometry, geo_6], Material=material_3)
preview_2 = CustomPreview(Geometry=[move_5.Geometry, geo_5], Material=material_4)

# ---- group: CarboCalc
panel_6 = Panel(item)
panel_7 = Panel("0")
panel_8 = Panel(panel_5)
panel_9 = Panel("Floor")
panel_10 = Panel(item_2)
carbo_life_element = CarboLifeElement(IdGUID="0", ElementName="RC Slab", MaterialName=panel_6, Volume=volume_2.Volume, Category="Floor", GUID=id_2)  # -> CarboElement, Message
panel_11 = Panel(carbo_life_element.CarboElement)
panel_12 = Panel(carbo_life_element.Message)

# ----
carbo_life_geo_element = CarboLifeGeoElement(IdGUID=panel_7, ElementName=panel_5, MaterialName=panel_10, Geometry=geo_3, Category=panel_9)  # -> CarboElement, Message

# ---- group: Create Project By Groups
material_5 = Materials({"Concrete - Mortar/screed": 0, "Concrete UK - C40/50 - Precast": 1, "Concrete UK - C32/40 - 25% GGBS": 2, "Concrete UK - C25/30 - 25% GGBS": 3, "Concrete UK - C20/25 - 25% GGBS": 4, "Concrete UK - C16/20 - 25% GGBS": 5, "Concrete UK - C40/50 - 25% GGBS": 6, "Concrete - C32/40 Mean": 7, "Concrete UK - C40/50 - Precast 150mm Hollowcore": 8, "Steel UK - Reinforcement": 9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}, selected="Steel - Generic": 82)
material_6 = Materials({"Concrete - Mortar/screed": 0, "Concrete UK - C40/50 - Precast": 1, "Concrete UK - C32/40 - 25% GGBS": 2, "Concrete UK - C25/30 - 25% GGBS": 3, "Concrete UK - C20/25 - 25% GGBS": 4, "Concrete UK - C16/20 - 25% GGBS": 5, "Concrete UK - C40/50 - 25% GGBS": 6, "Concrete - C32/40 Mean": 7, "Concrete UK - C40/50 - Precast 150mm Hollowcore": 8, "Steel UK - Reinforcement": 9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}, selected="Concrete UK - C32/40 - 25% GGBS")
list_all_materials_3 = ListMaterials()
list_all_materials_4 = ListMaterials()
item_3 = ListItem(List=list_all_materials_3, Index=material_5, Wrap=True)
item_4 = ListItem(List=list_all_materials_4, Index=material_6, Wrap=True)
select_a_carbomaterial = SelectMaterials(MaterialName=item_3, MaterialCategory="Steel")  # -> CM, String
select_a_carbomaterial_2 = SelectMaterials(MaterialName=item_4, MaterialCategory="Concrete")  # -> CM, String
create_a_carbogroup = CarboGroup(CarboElement=carbo_life_geo_element.CarboElement, CarboMaterial=select_a_carbomaterial.CM)  # -> CarboGroup, Message
create_a_carbogroup_2 = CarboGroup(CarboElement=carbo_life_element.CarboElement, CarboMaterial=select_a_carbomaterial_2.CM)  # -> CarboGroup, Message
carbo_life_group_project_solver = ProjectGroupSolver(
    CarboGroups=[create_a_carbogroup.CarboGroup, create_a_carbogroup_2.CarboGroup],
    Switches=carbo_life_switches.CarboSwitches)  # -> Total, CarboProject, Message
panel_13 = Panel(carbo_life_group_project_solver.Total)

# ---- group: CarboCalc (continued)
carbo_life_project_solver_by_elements = ProjectElementSolver(CarboElements=carbo_life_geo_element.CarboElement, Switches=carbo_life_switches.CarboSwitches)  # -> Total, CarboProject, Message

# ----
panel_14 = Panel(carbo_life_project_solver_by_elements.CarboProject)
panel_15 = Panel(carbo_life_project_solver_by_elements.Message)
panel_16 = Panel(carbo_life_project_solver_by_elements.Total)
split = TextSplit(Text=panel_15, Separators=";")  # -> simplify(Result)
panel_17 = Panel(split)
int = Integer(1)
item_5 = ListItem(List=panel_17, Index=int, Wrap=True)
flatten = FlattenTree(Tree=item_5, Path="{0}")
panel_18 = Panel(flatten)
normalise = CSharpScript(x=panel_18)  # -> out, A; inputs x: list of Double
# ---------- normalise: C# ----------
    List<double> result = new List<double>();

    foreach(double nr in x)
    {
      if(nr < 0)
      {
        result.Add(Math.Round(nr * -1,1));
      }

      if(nr > 0)
      {
        result.Add(Math.Round(nr,1));
      }

    }
    A = result;
# ---------- end normalise ----------
panel_19 = Panel(normalise.A)
repeat = RepeatData(Data=graft(normalise.A), Length=graft(normalise.A))  # -> flatten(Data)
pie = PieChart(repeat)

panel_20 = Panel(select_a_carbomaterial_2.String)
panel_21 = Panel(select_a_carbomaterial.String)

# ---- group: Save Project
save_project = SaveACarboLifeProject(Project=carbo_life_group_project_solver.CarboProject, Path="C:\Temp\RhinoSave.clcx", Save=Toggle(True))
panel_22 = Panel(save_project)

# ----
colour_geo_if_available = CarboCrocPainter(CarboProject=carbo_life_group_project_solver.CarboProject)  # -> Message, Geo

split_2 = TextSplit(Text=carbo_life_group_project_solver.Message, Separators=";")  # -> simplify(Result)
panel_23 = Panel(split_2)
int_2 = Integer(1)
item_6 = ListItem(List=panel_23, Index=int_2, Wrap=True)
flatten_2 = FlattenTree(Tree=item_6, Path="{0}")
panel_24 = Panel(flatten_2)
normalise_2 = CSharpScript(x=panel_24)  # -> out, A; inputs x: list of Double; same code as normalise
panel_25 = Panel(normalise_2.A)
repeat_2 = RepeatData(Data=graft(normalise_2.A), Length=graft(normalise_2.A))  # -> flatten(Data)
pie_2 = PieChart(repeat_2)

panel_26 = Panel(colour_geo_if_available.Message)
panel_27 = Panel(colour_geo_if_available.Geo)
