# Grasshopper definition existing_struct.gh (Grasshopper 1.0.7)
# plug-ins: Kangaroo2 Components, Rhino.Inside for Autodesk Revit

x_grid_spacing = Slider(6000, range=0..10000)
y_grid_spacing = Slider(8000, range=0..10000)
pt = Point(Point(0, 0, 0))
levels = Panel("""4000
8000
12000""")
lng = ListLength(List=levels)
vec = VectorXYZ(XComponent=0, YComponent=0, ZComponent=levels)  # -> Vector, Length
subtraction = Subtraction(A=lng, B=Slider(1, range=0..1))
vec_2 = VectorXYZ(XComponent=x_grid_spacing, YComponent=0, ZComponent=0)  # -> Vector, Length
vec_3 = VectorXYZ(XComponent=0, YComponent=y_grid_spacing, ZComponent=0)  # -> Vector, Length
item = ListItem(List=vec.Vector, Index=subtraction, Wrap=True)
move = Move(Geometry=pt, Motion=vec_2.Vector)  # -> Geometry, Transform
move_2 = Move(Geometry=pt, Motion=item)  # -> Geometry, Transform
move_3 = Move(Geometry=pt, Motion=vec_3.Vector)  # -> Geometry, Transform
pt_2 = ConstructPoint(XCoordinate=x_grid_spacing, YCoordinate=y_grid_spacing, ZCoordinate=0)
ln = Line(StartPoint=pt, EndPoint=move_3.Geometry)
ln_2 = Line(StartPoint=pt, EndPoint=move.Geometry)
rec_2pt = Rectangle2Pt(Plane=PlaneXY(0, 0, 0), PointA=pt, PointB=pt_2, Radius=0)  # -> Rectangle, Length
ln_3 = Line(StartPoint=pt, EndPoint=move_2.Geometry)
move_4 = Move(Geometry=ln_2, Motion=vec_3.Vector)  # -> Geometry, Transform
move_5 = Move(Geometry=ln, Motion=vec_2.Vector)  # -> Geometry, Transform
number_slider = Slider(6, range=0..10)
number_slider_2 = Slider(3, range=0..10)
line = Line([move_5.Geometry, ln])
line_2 = Line([ln_2, move_4.Geometry])
rec = Rectangle(rec_2pt.Rectangle)
panel = Panel("1")
divide = DivideCurve(Curve=move_4.Geometry, Count="3", Kinks=False)  # -> Points, Tangents, Parameters
divide_2 = DivideCurve(Curve=ln_2, Count="3", Kinks=False)  # -> Points, Tangents, Parameters
addition = Addition(A=number_slider, B=1)
addition_2 = Addition(A=number_slider_2, B=1)
c_script = CSharpScript(pntList=divide.Points)  # -> out, A; inputs pntList: list of Point3d
# ---------- c_script: C# ----------
   //myList.RemoveAt(indexToRemove);
    pntList.RemoveAt(pntList.Count - 1);

    pntList.RemoveAt(0);
    A = pntList;
# ---------- end c_script ----------
c_script_2 = CSharpScript(pntList=divide_2.Points)  # -> out, A; inputs pntList: list of Point3d; same code as c_script
arrrec = RectangularArray(Geometry=ln_3, Cell=rec, XCount=addition, YCount=addition_2)  # -> flatten(Geometry), Transform
ln_4 = Line(StartPoint=c_script_2.A, EndPoint=c_script.A)
arrrec_2 = RectangularArray(Geometry=line, Cell=rec, XCount=number_slider, YCount=number_slider_2)  # -> flatten(Geometry), Transform
arrrec_3 = RectangularArray(Geometry=line_2, Cell=rec, XCount=number_slider, YCount=number_slider_2)  # -> flatten(Geometry), Transform
arrrec_4 = RectangularArray(Geometry=ln_4, Cell=rec, XCount=number_slider, YCount=number_slider_2)  # -> flatten(Geometry), Transform
dupln = RemoveDuplicateLines(Lines=arrrec_4.Geometry, Tolerance=0.01)
dupln_2 = RemoveDuplicateLines(Lines=arrrec_2.Geometry, Tolerance=0.01)  # -> flatten(UniqueLines)
vec_4 = VectorXYZ(XComponent=0, YComponent=0, ZComponent=levels)  # -> Vector, Length
dupln_3 = RemoveDuplicateLines(Lines=arrrec_3.Geometry, Tolerance=0.01)
group = Group(Objects=dupln_3)
group_2 = Group(Objects=dupln)
group_3 = Group(Objects=dupln_2)
move_6 = Move(Geometry=group_3, Motion=vec_4.Vector)  # -> Geometry, Transform
move_7 = Move(Geometry=group, Motion=vec_4.Vector)  # -> Geometry, Transform
move_8 = Move(Geometry=group_2, Motion=vec_4.Vector)  # -> Geometry, Transform
ungroup = Ungroup(Group=move_7.Geometry)
ungroup_2 = Ungroup(Group=move_8.Geometry)
ungroup_3 = Ungroup(Group=move_6.Geometry)

# ---- group: Beams
panel_2 = Panel("UB-Universal Beams")
category = Category(<category referenced from the Revit model>)
types = QueryTypes(Kind=3, Category=category, FamilyName=panel_2, TypeName="UB254x146x43")
item_2 = ListItem(List=types, Index=0, Wrap=True)
s_beam = AddStructuralBeam(Curve=ungroup_2, Type=item_2, TrackingMode=2)

# ----
famfltr = FamilyFilter(FamilyName=panel_2, Inverted=False)
types_2 = FamilyTypes(Family=famfltr)

# ---- group: Beams
category_2 = Category(<category referenced from the Revit model>)
types_3 = QueryTypes(Kind=3, Category=category_2, FamilyName="UB-Universal Beams", TypeName="UB457x191x89")
item_3 = ListItem(List=types_3, Index=0, Wrap=True)
s_beam_2 = AddStructuralBeam(Curve=ungroup, Type=item_3, TrackingMode=2)

category_3 = Category(<category referenced from the Revit model>)
types_4 = QueryTypes(Kind=3, Category=category_3, FamilyName="UB-Universal Beams", TypeName="UB356x171x67")
item_4 = ListItem(List=types_4, Index=0, Wrap=True)
s_beam_3 = AddStructuralBeam(Curve=ungroup_3, Type=item_4, TrackingMode=2)

# ----
panel_3 = Panel("1000x550 RC COLUMN")
# DRAW IN REVIT
levels_2 = LevelsPicker(<levels picker referenced from the Revit model>)
panel_4 = Panel("WW_ST_Concrete-Rectangular-Column")
category_4 = Category(<category referenced from the Revit model>)
types_5 = QueryTypes(Kind=3, Category=category_4, FamilyName="UC-Universal Columns-Column", TypeName="UC254x254x73")
item_5 = ListItem(List=types_5, Index=0, Wrap=True)
number_slider_3 = Slider(20, range=0..90)
s_column = AddStructuralColumn(Curve=arrrec.Geometry, Type=item_5, BaseLevel=levels_2, TopLevel=levels_2, TrackingMode=2)
parameter = Parameter(<parameter referenced from the Revit model>, SelectedBuiltInCategory="autodesk.revit.category.family:structuralFraming")
rad = Radians()
param = ElementParameter(Parameter=parameter, Value=rad)  # -> Element, Value; disabled
